# Dynamo graph WorksetCreation_Visibility.dyn (Dynamo 2.6.1.8786)

python_script = Python()  # unwired: IN[0]
# ---------- python_script.python (27 lines) ----------
import clr
clr.AddReference('RevitAPI')
from Autodesk.Revit.DB import *
from Autodesk.Revit import DB 

clr.AddReference("RevitNodes")
import Revit
clr.ImportExtensions(Revit.Elements)

clr.AddReference("RevitServices")
import RevitServices
from RevitServices.Persistence import DocumentManager
from RevitServices.Transactions import TransactionManager

doc = DocumentManager.Instance.CurrentDBDocument
worksets = IN[0]

TransactionManager.Instance.EnsureInTransaction(doc)
Output = []

for workset in worksets:
	ws = UnwrapElement(workset)
	settings = WorksetDefaultVisibilitySettings.GetWorksetDefaultVisibilitySettings(doc)
	settings.SetWorksetVisibility(DB.WorksetId(ws.Id), False)
	Output.append(ws.Id)
TransactionManager.Instance.TransactionTaskDone()
OUT = Output
# ----------------------------------------

# group: WORKSET NAMES
code_block = CodeBlock { ["Interior_FFE", "Life_Safety", "Interior_Hidden"]; }

# group: CREATE WORKSETS
python_script_2 = Python(IN[0]=code_block)
# ---------- python_script_2.python (43 lines) ----------
# Load the Python Standard and DesignScript Libraries
import clr

clr.AddReference('RevitAPI')
from Autodesk.Revit import DB
from Autodesk.Revit.DB.Structure import *

clr.AddReference('RevitAPIUI')
from Autodesk.Revit.UI import *

clr.AddReference('System')
from System.Collections.Generic import List

clr.AddReference('RevitNodes')
import Revit
clr.ImportExtensions(Revit.GeometryConversion)
clr.ImportExtensions(Revit.Elements)

clr.AddReference('RevitServices')
import RevitServices
from RevitServices.Persistence import DocumentManager
from RevitServices.Transactions import TransactionManager

doc = DocumentManager.Instance.CurrentDBDocument
#uidoc=DocumentManager.Instance.CurrentUIApplication.ActiveUIDocument

#Preparing input from dynamo to revit

def create_worksets(d, names):
	new_Worksets = []
	for name in names:
		ws = DB.Workset.Create(d, name)
		new_Worksets.append(ws)
	return new_Worksets
        
#Do some action in a Transaction

workset_Names = IN[0]

TransactionManager.Instance.EnsureInTransaction(doc)
OUT = create_worksets(doc, workset_Names)

TransactionManager.Instance.TransactionTaskDone()
# ----------------------------------------

# group: SET VISIBILITY
python_script_3 = Python(IN[0]=python_script_2)
# ---------- python_script_3.python (45 lines) ----------
# Load the Python Standard and DesignScript Libraries
import clr

clr.AddReference('RevitAPI')
from Autodesk.Revit import DB
from Autodesk.Revit.DB.Structure import *

clr.AddReference('RevitAPIUI')
from Autodesk.Revit.UI import *

clr.AddReference('System')
from System.Collections.Generic import List

clr.AddReference('RevitNodes')
import Revit
clr.ImportExtensions(Revit.GeometryConversion)
clr.ImportExtensions(Revit.Elements)

clr.AddReference('RevitServices')
import RevitServices
from RevitServices.Persistence import DocumentManager
from RevitServices.Transactions import TransactionManager

doc = DocumentManager.Instance.CurrentDBDocument
#uidoc=DocumentManager.Instance.CurrentUIApplication.ActiveUIDocument

#Preparing input from dynamo to revit
        
#Do some action in a Transaction

worksets = UnwrapElement(IN[0])

def set_workset_default_visiblity(d, workset, state):
    wdvs = DB.WorksetDefaultVisibilitySettings.GetWorksetDefaultVisibilitySettings(d)
    wdvs.SetWorksetVisibility(workset.Id, state)

TransactionManager.Instance.EnsureInTransaction(doc)

for workset in worksets:
	if "Hidden" in workset.Name:
		set_workset_default_visiblity(doc, workset, False)

OUT = 0

TransactionManager.Instance.TransactionTaskDone()
# ----------------------------------------
